# Dynamo graph lineColumn.dyn (Dynamo 2.1.0.7500)

select_model_elements = DSModelElementsSelection()  # 3 picked in the model
curves = Element.Curves(element=select_model_elements)
code_block = CodeBlock { 0; }
pointAtParameter = Curve.PointAtParameter(curve=curves, param=code_block)
code_block_2 = CodeBlock()
# ---------- code_block_2.designscript (2 lines) ----------
//输入柱状体半径
30;
# ----------------------------------------
direction = Line.Direction(line=curves)
byCenterPointRadiusNormal = Circle.ByCenterPointRadiusNormal(centerPoint=pointAtParameter, radius=code_block_2, normal=direction)
bySweep = Solid.BySweep(profile=byCenterPointRadiusNormal, path=curves)
byGeometry = ImportInstance.ByGeometry(geometry=bySweep)
